# Grasshopper definition truchet_multiscale.gh (Grasshopper 0.9.80)

# ---- group: Create the grid
number_slider = Slider(25, range=1..100)
number_slider_2 = Slider(10, range=1..10)
division = Division(A=number_slider, B=Slider(2, range=1..5))
sqgrid = Square(Plane=PlaneXY(0, 0, 0), Size=number_slider_2, ExtentX=number_slider, ExtentY=division)  # -> Cells, Points
pcen = PolygonCenter(Polyline=sqgrid.Cells)  # -> CenterV, CenterE, flatten(CenterA)

number_slider_3 = Slider(25, range=1..100)
number_slider_4 = Slider(10, range=1..10)
division_2 = Division(A=number_slider_3, B=Slider(2, range=1..5))
sqgrid_2 = Square(
    Plane=PlaneXY(0, 0, 0),
    Size=expr("x / 2", number_slider_4),
    ExtentX=expr("x*2", number_slider_3),
    ExtentY=expr("x*2", division_2))  # -> Cells, Points
pcen_2 = PolygonCenter(Polyline=sqgrid_2.Cells)  # -> CenterV, CenterE, flatten(CenterA)

# ---- group: Move the pre-made geometry to each cell
pt = ConstructPoint(XCoordinate=expr("x/2", number_slider_2), YCoordinate=expr("x/2", number_slider_2), ZCoordinate=0)
crv = Curve([<curve referenced from the Rhino model> x24])
group = Group(Objects=crv)
vec2pt = Vector2Pt(PointA=pt, PointB=pcen.CenterA, Unitize=False)  # -> Vector, Length
move = Move(Geometry=group, Motion=vec2pt.Vector)  # -> flatten(Geometry), Transform

pt_2 = ConstructPoint(XCoordinate=expr("x/4", number_slider_4), YCoordinate=expr("x/4", number_slider_4), ZCoordinate=0)
crv_2 = Curve([<curve referenced from the Rhino model> x11])
group_2 = Group(Objects=crv_2)
vec2pt_2 = Vector2Pt(PointA=pt_2, PointB=pcen_2.CenterA, Unitize=False)  # -> Vector, Length
move_2 = Move(Geometry=group_2, Motion=vec2pt_2.Vector)  # -> flatten(Geometry), Transform

# ---- group: Randomly rotate every cell (a multiple of 90)
lng = ListLength(List=move.Geometry)
random = Random(Range=Domain(0, 1), Number=lng, Seed=2)
multiplication = Multiplication(A=random, B=Slider(6, range=0..10))
addition = Addition(A=multiplication, B=Slider(1, range=0..1))
round = Round(Number=addition)  # -> Nearest, Floor, Ceiling
panel = Panel(round.Floor)
multiplication_2 = Multiplication(A=Slider(90, range=0..360), B=panel)

lng_2 = ListLength(List=move_2.Geometry)
random_2 = Random(Range=Domain(0, 1), Number=lng_2, Seed=2)
multiplication_3 = Multiplication(A=random_2, B=Slider(6, range=0..10))
addition_2 = Addition(A=multiplication_3, B=Slider(1, range=0..1))
round_2 = Round(Number=addition_2)  # -> Nearest, Floor, Ceiling
panel_2 = Panel(round_2.Floor)
multiplication_4 = Multiplication(A=Slider(90, range=0..360), B=panel_2)

# ----
xy = XYPlane(Origin=pcen.CenterA)
xy_2 = XYPlane(Origin=pcen_2.CenterA)
rotate = Rotate(Geometry=move.Geometry, Angle=degrees(multiplication_2), Plane=xy)  # -> Geometry, Transform
rotate_2 = Rotate(Geometry=move_2.Geometry, Angle=degrees(multiplication_4), Plane=xy_2)  # -> Geometry, Transform
